# Grasshopper definition full_mockup.gh (Grasshopper 0.9.76)
# plug-ins: Python Interpreter

python = PythonScript()  # -> form, force
# ---------- python: Python ----------
from compas_tna.diagrams import FormDiagram
from compas_tna.diagrams import ForceDiagram

_form = FormDiagram.from_json('C:/Users/Kam-Ming Mark Tam/Documents/GitHub/AAG2018/AAG2018/src/day_1/final/aag_02_formdiagram.json')
_force = ForceDiagram.from_json('C:/Users/Kam-Ming Mark Tam/Documents/GitHub/AAG2018/AAG2018/src/day_1/final/aag_03_forcediagram.json')

form = _form
force = _force

_form.set_edges_attribute('fmin', 0.2)
_form.set_edges_attribute('fmax', 5.0)
# ---------- end python ----------

# ---- group: Proxy Reset
python_2 = PythonScript()  # -> out, a
# ---------- python_2: Python ----------
from compas.rpc import Proxy
compas_tna = Proxy('compas_ghc.tna')
compas_tna.stop_server()
compas_tna = Proxy('compas_ghc.tna')
# ---------- end python_2 ----------

# ----
rectangle = Rectangle(Plane=PlaneXY(0, 0, 0), XSize=Domain(-1, 1), YSize=Domain(-2, 2), Radius=0)  # -> Rectangle, Length
data = Data(python.form)
mesh_uv = MeshSurface(Surface=rectangle.Rectangle, UCount=5, VCount=5, Overhang=True, Equalize=False)
data_2 = Data()
anchor_points = AnchorPoints()
formdiagram = FormDiagram()
mesh = Mesh(mesh_uv)
formdiagram_2 = FormDiagram()
forcediagram = ForceDiagram()

# ---- group: Γ
data_3 = Data(data)

# ----
data_4 = Data(data_2)
data_5 = Data(anchor_points)
data_6 = Data(formdiagram)
python_3 = PythonScript()  # -> Out, A
assemblestructuraldesign = AssembleStructuralDesign(formdiagram=data_3)
cluster = Cluster_5(mesh=mesh)

# ---- group: structDsg
data_7 = Data(assemblestructuraldesign)

# ---- group: CreateDualDiagram
cluster_2 = Cluster(structuraldesign_0=data_7)  # -> structuraldesign_1, forcediagram_1

# ----
assemblestructuraldesign_2 = AssembleStructuralDesign_2()
number_slider = Slider(100, range=0..100)
number_slider_2 = Slider(100, range=0..100)

# ---- group: structDsg
data_8 = Data(cluster_2.structuraldesign_1)

# ----
int = Integer()
int_2 = Integer()

# ---- group: DisassembleStructuralDesign
cluster_3 = Cluster_2()  # -> structuraldesign_1, forcediagram_1

# ---- group: HorizontalEquilibrium
cluster_4 = Cluster_3(structuraldesign_0=data_8, alpha=int_2, maxiterations=int)  # -> structuraldesign_1, formdiagram_1, forcediagram_1

# ---- group: structDsg
data_9 = Data(cluster_4.structuraldesign_1)

# ---- group: VerticalEquilibrium
cluster_5 = Cluster_4(structuraldesign_0=data_9, maxheight=Slider(6, range=0..10))  # -> structuraldesign_1, formdiagram_1

# ----
python_4 = PythonScript(quad_mesh_datastructure=cluster_5.formdiagram_1)  # -> out, guid
# ---------- python_4: Python ----------
from compas_pattern.cad.rhino.utilities import draw_mesh

guid = draw_mesh(quad_mesh_datastructure, group = False)
# ---------- end python_4 ----------

# ==== cluster AssembleStructuralDesign
formdiagram = ClusterInput()
forcediagram = ClusterInput()
python = PythonScript(formDiag=formdiagram, forceDiag=forcediagram)  # -> structDsg
# ---------- python: Python ----------
#from compas.rpc import Proxy
#reload(compas_ghc.datastructures.StructuralDesign)
import compas_ghc.utilities.InputsOutputsProcessing as _IOP
reload(_IOP)
import compas_ghc.datastructures.StructuralDesign as _SD
reload(_SD)

from compas_ghc.datastructures.StructuralDesign import StructuralDesign as StructDsg


#if form or force diagrams are valid?
_structDsg = StructDsg()

if formDiag is not None:
    _structDsg.SetFormDiagram(formDiag)
    
if forceDiag is not None:
    _structDsg.SetForceDiagram(forceDiag)
    
structDsg = _structDsg
# ---------- end python ----------
structuraldesign = ClusterOutput(python)

# ==== cluster Cluster
structuraldesign_0 = ClusterInput()
createdualdiagram = PythonScript(structDsg_0=structuraldesign_0)  # -> structDsg_1, forceDiag_1
# ---------- createdualdiagram: Python ----------
#from compas_tna.rhino import DiagramHelper
from compas_tna.diagrams import ForceDiagram

if structDsg_0 is not None:
    _structDsg_0    = structDsg_0
    _formDiag       = _structDsg_0.formDiag
    _forceDiag      = ForceDiagram.from_formdiagram(_formDiag)
    _structDsg_0.SetForceDiagram(_forceDiag)

    structDsg_1 = _structDsg_0
    forceDiag_1 = _forceDiag
# ---------- end createdualdiagram ----------
structuraldesign_1 = ClusterOutput(createdualdiagram.structDsg_1)
forcediagram_1 = ClusterOutput(createdualdiagram.forceDiag_1)

# ==== cluster AssembleStructuralDesign_2
formdiagram = ClusterInput()
forcediagram = ClusterInput()
python = PythonScript(formDiag=formdiagram, forceDiag=forcediagram)  # -> structDsg
# ---------- python: Python ----------
#from compas.rpc import Proxy
#reload(compas_ghc.datastructures.StructuralDesign)
from compas_ghc.datastructures.StructuralDesign import StructuralDesign as StructDsg


#if form or force diagrams are valid?
_structDsg = StructDsg()

if formDiag is not None:
    _structDsg.SetFormDiagram(formDiag)
    
if forceDiag is not None:
    _structDsg.SetForceDiagram(forceDiag)
    
structDsg = _structDsg
# ---------- end python ----------
structuraldesign = ClusterOutput(python)

# ==== cluster Cluster_2
structuraldesign_0 = ClusterInput()
createdualdiagram = PythonScript(structDsg_0=structuraldesign_0)  # -> formDiag, forceDiag
# ---------- createdualdiagram: Python ----------
#from compas_tna.rhino import DiagramHelper
from compas_tna.diagrams import ForceDiagram

if structDsg_0 is not None:
    _structDsg_0    = structDsg_0
    
    _formDiag       = _structDsg_0.formDiag
    _forceDiag      = _structDsg_0.forceDiag
    
    
    formDiag        = _formDiag
    forceDiag       = _forceDiag
# ---------- end createdualdiagram ----------
structuraldesign_1 = ClusterOutput(createdualdiagram.formDiag)
forcediagram_1 = ClusterOutput(createdualdiagram.forceDiag)

# ==== cluster Cluster_3
structuraldesign_0 = ClusterInput()
alpha = ClusterInput()  # default: 100
maxiterations = ClusterInput()  # default: 100
data = Data(alpha)
data_2 = Data(maxiterations)
data_3 = Data(structuraldesign_0)
python = PythonScript(structDsg_0=data_3, flt_Alpha=data, int_KMax=data_2)  # -> structDsg_1, formDiag_1, forceDiag_1
# ---------- python: Python ----------
from compas_ghc.utilities.InputsOutputsProcessing import GrasshopperInputsGate
from compas_ghc.utilities.InputsOutputsProcessing import SetDefaultInput as SetDfltInp
from compas_ghc.datastructures.StructuralDesign import StructuralDesign as StructDsg


_structDsg_0=structDsg_0
if GrasshopperInputsGate(_structDsg_0, 'StructuralDesign'):
    
    from compas.rpc import Proxy
    _tna = Proxy('compas_ghc.tna')

    from copy import deepcopy
    from compas_tna.diagrams import FormDiagram
    from compas_tna.diagrams import ForceDiagram
    
    _formDiag_0, _forceDiag_0 = _structDsg_0.OutputDualDiagrams()
    
    _flt_Alpha = SetDfltInp(flt_Alpha, 100)
    _int_KMax = SetDfltInp(int_KMax, 100)

    _formData_0 = deepcopy(_formDiag_0.to_data())
    _forceData_0 = deepcopy(_forceDiag_0.to_data())
    
    try:
        _formData_1, _forceData_1 = _tna.horizontal_nodal_from_data(_formData_0 , _forceData_0, alpha=_flt_Alpha, kmax=_int_KMax)
        try:
            _formDiag_1     = FormDiagram.from_data(_formData_1)
            _forceDiag_1    = ForceDiagram.from_data(_forceData_1)
        
            _structDsg_1    = StructDsg()
            _structDsg_1.SetDualDiagrams(_formDiag_1, _forceDiag_1)
            
            formDiag_1      = _formDiag_1
            forceDiag_1     = _forceDiag_1
            structDsg_1     = _structDsg_1
        except:
            pass
        
    except:
        pass
# ---------- end python ----------
data_4 = Data(python.structDsg_1)
data_5 = Data(python.forceDiag_1)
data_6 = Data(python.formDiag_1)
formdiagram_1 = ClusterOutput(data_6)
structuraldesign_1 = ClusterOutput(data_4)
forcediagram_1 = ClusterOutput(data_5)

# ==== cluster Cluster_4
structuraldesign_0 = ClusterInput()
maxheight = ClusterInput()
maxiterations = ClusterInput()
data = Data(maxiterations)
data_2 = Data(maxheight)
data_3 = Data(structuraldesign_0)
python = PythonScript(structDsg_0=data_3, int_KMax=data, flt_ZMax=data_2)  # -> out, structDsg_1, formDiag_1
# ---------- python: Python ----------
from compas_ghc.utilities.InputsOutputsProcessing import GrasshopperInputsGate
from compas_ghc.utilities.InputsOutputsProcessing import SetDefaultInput as SetDfltInp
from compas_ghc.datastructures.StructuralDesign import StructuralDesign as StructDsg


_structDsg_0=structDsg_0
if GrasshopperInputsGate(_structDsg_0, 'StructuralDesign'):
    
    from compas.rpc import Proxy
    _tna = Proxy('compas_ghc.tna')

    from copy import deepcopy
    from compas_tna.diagrams import FormDiagram
    
    _formDiag_0, _forceDiag_0 = _structDsg_0.OutputDualDiagrams()
    
    _int_KMax = SetDfltInp(int_KMax, 100)
    _flt_ZMax = SetDfltInp(flt_ZMax, 5)

    _formData_0 = deepcopy(_formDiag_0.to_data())

    try:
        
        _formData_1, _scale = _tna.vertical_from_zmax_from_data(_formData_0, zmax = _flt_ZMax, kmax = _int_KMax)
        

        try:
            _formDiag_1     = FormDiagram.from_data(_formData_1)
        
            _structDsg_1    = StructDsg()
            _forceDiag_1    = deepcopy (_forceDiag_0)
            _structDsg_1.SetDualDiagrams(_formDiag_1, _forceDiag_1)
            
            formDiag_1      = _formDiag_1
            structDsg_1     = _structDsg_1
        except:
            pass
        
    except:
        pass
# ---------- end python ----------
data_4 = Data(python.structDsg_1)
data_5 = Data(python.formDiag_1)
formdiagram_1 = ClusterOutput(data_5)
structuraldesign_1 = ClusterOutput(data_4)

# ==== cluster Cluster_5
mesh = ClusterInput()
data = Data(mesh)
python_script = PythonScript(rgMesh=data)  # -> out, cDiag
# ---------- python_script: Python ----------
from compas_ghc.utilities.InputsOutputsProcessing import GrasshopperInputsGate
from compas_ghc.utilities.InputsOutputsProcessing import SetDefaultInput as SetDfltInp
from compas_ghc.datastructures.StructuralDesign import StructuralDesign as StructDsg

from compas_rhino.geometry import RhinoMesh
from compas_tna.diagrams import FormDiagram

_rgMesh = rgMesh
if GrasshopperInputsGate(_rgMesh, 'Guid'):
    _cDiag = FormDiagram.from_vertices_and_faces(*(RhinoMesh.from_guid(rgMesh).get_vertices_and_faces()))
    cDiag = _cDiag
# ---------- end python_script ----------
data_2 = Data(python_script.cDiag)
diagram = ClusterOutput(data_2)
