# Grasshopper definition TNA_cnpt_mockup.gh (Grasshopper 0.9.76)
# plug-ins: Python Interpreter

forcediagram = ForceDiagram()

# ---- group: Proxy Reset
python = PythonScript()  # -> out, a
# ---------- python: Python ----------
from compas.rpc import Proxy
compas_tna = Proxy('compas_ghc.tna')
compas_tna.stop_server()
compas_tna = Proxy('compas_ghc.tna')
# ---------- end python ----------

# ----
formdiagram = FormDiagram()
python_2 = PythonScript()  # -> out, a
# ---------- python_2: Python ----------
from compas_ghc import datastructures as ds
reload(ds)
# ---------- end python_2 ----------
python_3 = PythonScript()  # -> form, force
# ---------- python_3: Python ----------
from compas_tna.diagrams import FormDiagram
from compas_tna.diagrams import ForceDiagram

_form = FormDiagram.from_json('C:/Users/Kam-Ming Mark Tam/Documents/GitHub/AAG2018/AAG2018/src/day_1/final/aag_02_formdiagram.json')
_force = ForceDiagram.from_json('C:/Users/Kam-Ming Mark Tam/Documents/GitHub/AAG2018/AAG2018/src/day_1/final/aag_03_forcediagram.json')

form = _form
force = _force

_form.set_edges_attribute('fmin', 0.2)
_form.set_edges_attribute('fmax', 5.0)
# ---------- end python_3 ----------
python_4 = PythonScript(formDiag=formdiagram, forceDiag=forcediagram)  # -> structDsg
# ---------- python_4: Python ----------
from compas.rpc import Proxy
reload(compas_ghc.datastructures.StructuralDesign)
from compas_ghc.datastructures.StructuralDesign import StructuralDesign as StructDsg


#if form or force diagrams are valid?
_structDsg = StructDsg()

if formDiag is not None:
    _structDsg.SetFormDiagram(FormDiagram)
    
if forceDiag is not None:
    _structDsg.SetForceDiagram(ForceDiagram)
    
structDsg = _structDsg
# ---------- end python_4 ----------
python_5 = PythonScript(form0=python_3.form, force0=python_3.force)  # -> out, form1, force1
# ---------- python_5: Python ----------
from compas.rpc import Proxy
from copy import deepcopy 

from compas_tna.diagrams import FormDiagram
from compas_tna.diagrams import ForceDiagram

_tna = Proxy('compas_ghc.tna')

_formdata_0 = deepcopy(form0.to_data())
_forcedata_0 = deepcopy(force0.to_data())

#_formdata_1, _forcedata_1 = _formdata_0, _forcedata_0
_formdata_1, _forcedata_1, _ = _tna.horizontal_nodal_from_data(_formdata_0 , _forcedata_0 , alpha=100, kmax=100)

form1 = FormDiagram.from_data(_formdata_1)
force1 = ForceDiagram.from_data(_forcedata_1)
# ---------- end python_5 ----------
structuraldesign = StructuralDesign(python_4)
python_6 = PythonScript()  # -> out, Form, Force; disabled
# ---------- python_6: Python ----------
from compas_tna.diagrams import FormDiagram
from compas_tna.diagrams import ForceDiagram
from compas_tna.equilibrium import horizontal_nodal_rhino as horizontal
from compas_tna.equilibrium import vertical_from_zmax_rhino as vertical

_form = FormDiagram.from_json('C:/Users/Kam-Ming Mark Tam/Documents/GitHub/AAG2018/AAG2018/src/day_1/final/aag_02_formdiagram.json')
_force = ForceDiagram.from_json('C:/Users/Kam-Ming Mark Tam/Documents/GitHub/AAG2018/AAG2018/src/day_1/final/aag_03_forcediagram.json')

_form.set_edges_attribute('fmin', 0.2)
_form.set_edges_attribute('fmax', 5.0)

horizontal(_form, _force, alpha=100, kmax=100)

zmax = 3

scale = vertical(_form, zmax, kmax=100)

Form = _form
Force = _force
# ---------- end python_6 ----------
python_7 = PythonScript()  # -> out, Form, Force; same code as python_6
python_8 = PythonScript(quad_mesh_datastructure=python_6.Form)  # -> out, guid; disabled
# ---------- python_8: Python ----------
from compas_pattern.cad.rhino.utilities import draw_mesh

guid = draw_mesh(quad_mesh_datastructure, group = False)
# ---------- end python_8 ----------
python_9 = PythonScript(quad_mesh_datastructure=python_6.Force)  # -> out, guid; disabled; same code as python_8
