# Grasshopper definition ForceDensityMethod.gh (Grasshopper 0.9.76)
# plug-ins: Python Interpreter, Kangaroo2 Components

rectangle = Rectangle(Plane=PlaneXY(0, 0, 0), XSize=Domain(-1, 1), YSize=Domain(-2, 2), Radius=0)  # -> Rectangle, Length
mesh_uv = MeshSurface(Surface=rectangle.Rectangle, UCount=5, VCount=5, Overhang=True, Equalize=False)
demesh = DeconstructMesh(Mesh=mesh_uv)  # -> Vertices, Faces, Colours, Normals
number_slider = Slider(3, range=0..10)
deface = DeconstructFace(Face=demesh.Faces)  # -> CornerA, CornerB, CornerC, CornerD
number_slider_2 = Slider(9, range=0..10)
rectangle_2 = Rectangle(Plane=PlaneXY(0, 0, 0), XSize=number_slider, YSize=number_slider, Radius=0)  # -> Rectangle, Length
mesh_uv_2 = MeshSurface(Surface=rectangle_2.Rectangle, UCount=number_slider_2, VCount=number_slider_2, Overhang=True, Equalize=False)
mesh = Mesh(mesh_uv_2)
mc = MeshCorners(Mesh=mesh, Angle=2.35619449)
pt = Point(mc)
mesh_2 = Mesh(mesh)
pt_2 = Point(pt)
cluster = Cluster(mesh=mesh_2)  # -> data_6, pt_4, data_5, data_4
data = Data(cluster.data_6)
data_2 = Data(cluster.data_5)
data_3 = Data(cluster.data_4)
pt_3 = Point(cluster.pt_4)
pt_4 = Point(pt_2)
num = Number(Slider(10, range=0..10))
pt_5 = Point(pt_4)
pt_6 = Point(pt_3)
cp = ClosestPoint(Point=pt_5, Cloud=pt_6)  # -> ClosestPoint, CPIndex, Distance
python = PythonScript()  # -> out, a
# ---------- python: Python ----------
from compas.rpc import Proxy

p = Proxy()
# ---------- end python ----------
int = Integer(cp.CPIndex)
data_4 = Data(data)
num_2 = Number(num)
python_2 = PythonScript(mesh=data_4, loadTotal=num_2, fixed=int)  # -> out, verticesNew, linesNew, force, length; inputs fixed: list of Int32
# ---------- python_2: Python ----------
import compas
import time

import rhinoscriptsyntax as rs

from compas.datastructures import Mesh
from compas.utilities import XFunc
from compas.rpc import Proxy

numerical = Proxy('compas.numerical')


def _updateVerticesCoordinates (mesh, xyz):
    for key, attr in mesh.vertices(True):
       attr['x'] = xyz[key][0]
       attr['y'] = xyz[key][1]
       attr['z'] = xyz[key][2]
    return mesh;
       

len_vertices = mesh.number_of_vertices()
_load = loadTotal/len_vertices

i=0

from copy import deepcopy
_mesh = deepcopy(mesh)
while (i<2):

    vertices = _mesh.get_vertices_attributes('xyz')
    
    verticesAreas=[]
    for _vkey in _mesh.vertex.keys():
        verticesAreas.append(_mesh.vertex_area(_vkey))
    sum_VerticesAreas = sum(verticesAreas)
    _loadFactor = loadTotal / sum_VerticesAreas
    _loads = [[0,0,verticesAreas[_vkey]*_loadFactor] for _vkey in _mesh.vertex.keys()]
    
    edges    = list(_mesh.edges())
    #fixed    = list([key for key in mesh.vertices() if mesh.vertex_degree(key) == 2])
    q        = _mesh.get_edges_attribute('q', 1.0)
    loads    = _mesh.get_vertices_attributes(('px', 'py', 'pz'), (0.0, 0.0, _load))
    
    xyzs, q, f, l, r = numerical.fd_numpy(vertices, edges, fixed, q, _loads)
    
    _mesh = _updateVerticesCoordinates (_mesh, xyzs)

    i+=1
    
    verticesNew=[]
    [verticesNew.append(rs.AddPoint(_xyz[0],_xyz[1],_xyz[2])) for _xyz in xyzs]
    linesNew=[]
    [linesNew.append(rs.AddLine(verticesNew[_ekey[0]],verticesNew[_ekey[1]])) for _ekey in _mesh.edges()]
    force = [_f[0] for _f in f]
    



#length = [rs.CurveLength(_line) for _line in linesNew]
#
#print(type(xyz))
#


# plotter = MeshPlotter(mesh)
# plotter.draw_vertices()
# plotter.draw_faces()
# plotter.draw_edges()
# plotter.show()
#
#print(fd_numpy.profile)
#
# ---------- end python_2 ----------
pt_7 = Point(python_2.verticesNew)
crv = Curve(python_2.linesNew)
data_5 = Data()
data_6 = Data()
multiplication = Multiplication(A=data_5, B=data_6)
ma = MassAddition(Input=multiplication)  # -> Result, PartialResults
panel = Panel(ma.Result)

# ==== cluster Cluster
mesh = ClusterInput()
mesh_2 = Mesh(mesh)
demesh = DeconstructMesh(Mesh=mesh_2)  # -> Vertices, Faces, Colours, Normals
deface = DeconstructFace(Face=demesh.Faces)  # -> CornerA, CornerB, CornerC, CornerD
merge = Merge(
    Data1=simplify(graft(deface.CornerA)),
    Data2=simplify(graft(deface.CornerB)),
    Data3=simplify(graft(deface.CornerC)),
    Data4=simplify(graft(deface.CornerD)))
pt = Point(demesh.Vertices)
pt_2 = Point(demesh.Vertices)
lng = ListLength(List=merge)
python = PythonScript(vertices=pt_2, a=deface.CornerA, b=deface.CornerB, c=deface.CornerC, d=deface.CornerD)  # -> out, mesh, edgeU, edgeV, a; inputs vertices: list of Point3d, a: list of Int32, b: list of Int32, c: list of Int32, d: list of Int32
# ---------- python: Python ----------
from compas.datastructures import Mesh

mesh = Mesh ()


_nFaces = len(a)

#_vertices = [[_v[0],_v[1],_v[2]] for _v in vertices]
[mesh.add_vertex(x=_v[0],y=_v[1],z=_v[2]) for _v in vertices]
for _i in range (0, _nFaces):
    mesh.add_face([a[_i],b[_i],c[_i],d[_i]])

edges = mesh.edges()
edgeU,edgeV=[],[]
[[edgeU.append(_uv[0]),edgeV.append(_uv[1])] for _uv in edges]
# ---------- end python ----------
repeat = RepeatData(Data=",", Length=expr("x-1", lng))  # -> simplify(Data)
weave = Weave(Pattern=[0, 1], Stream0=merge, Stream1=repeat, NullGaps=False)
python_2 = PythonScript(x=weave)  # -> a; inputs x: list
# ---------- python_2: Python ----------
_n = len(x)

_str = ""
for _x in x:
    _str = _str + str(_x)
    
a=_str
# ---------- end python_2 ----------
concat = Concatenate(FragmentA=python.edgeU, FragmentC=",", FragmentB=python.edgeV)
data = Data(simplify(graft(concat)))
data_2 = Data(python_2)
pt_3 = Point(pt)
data_3 = Data(python.mesh)
data_4 = ClusterOutput(data_2)
pt_4 = ClusterOutput(pt_3)
data_5 = ClusterOutput(data)
data_6 = ClusterOutput(data_3)
